# Grasshopper definition 3d_isovist_sampling.gh (Grasshopper 1.0.8)

crv = Curve([<curve referenced from the Rhino model> x100])

# ----
# Start
toggle = BooleanToggle(False)

divlength = DivideLength(Curve=crv, Length="5")  # -> Points, Tangents, Parameters
brep = Brep(<brep referenced from the Rhino model>)
py3 = Python3Script(Start=toggle, Pts=divlength.Points, Geo=brep)  # -> out, a, b; inputs Pts: tree
# ---------- py3: Python ----------
import Rhino.Geometry as rg
import Rhino
import scriptcontext as sc
import math
import System.IO as IO
import System


SaveFolder = r"C:\Users\shrua\OneDrive\Desktop\threshold project"
RayCount = 2048
MaxDist = 10.0

if Start:

    # Fibonacci Sphere for Ray Directions
    def sphere_directions(n):
        dirs = []
        offset = 2.0 / n
        inc = math.pi * (3.0 - math.sqrt(5.0))
        for i in range(n):
            y = ((i * offset) - 1) + (offset / 2)
            r = math.sqrt(1 - y * y)
            phi = i * inc
            x = math.cos(phi) * r
            z = math.sin(phi) * r
            dirs.append(rg.Vector3d(x, y, z))
        return dirs

    # Preprocess Geometry
    Geo = list(Geo) if isinstance(Geo, (list, tuple)) else [Geo]
    meshes = []
    for ref in Geo:
        rh_obj = sc.doc.Objects.Find(ref)
        if rh_obj:
            geom = rh_obj.Geometry
            if isinstance(geom, rg.Brep):
                mesh_array = rg.Mesh.CreateFromBrep(geom, rg.MeshingParameters.Default)
                if mesh_array:
                    for m in mesh_array:
                        m.RebuildNormals()
                        meshes.append(m)
            elif isinstance(geom, rg.Mesh):
                geom.RebuildNormals()
                meshes.append(geom)

    dirs = sphere_directions(RayCount)
    RayLines = []
    ExportedFiles = []

    # Handle multiple branches of points
    for i, branch in enumerate(Pts.Branches):

        real_pts = []
        for ref in branch:
            rh_obj = sc.doc.Objects.Find(ref)
            if rh_obj and hasattr(rh_obj.Geometry, "Location"):
                real_pts.append(rh_obj.Geometry.Location)
            elif isinstance(ref, rg.Point3d):
                real_pts.append(ref)

        Isovists = []

        for pt in real_pts:
            dists = []
            for dir in dirs:
                dir.Unitize()
                ray = rg.Ray3d(pt, dir)
                dist = MaxDist
                for m in meshes:
                    t = rg.Intersect.Intersection.MeshRay(m, ray)
                    if t > 0 and t < dist:
                        dist = t
                dists.append(dist)
                RayLines.append(rg.Line(pt, dir * dist))
            Isovists.append(dists)

        # Save to file
        if not IO.Directory.Exists(SaveFolder):
            IO.Directory.CreateDirectory(SaveFolder)

        filename = "curve_{:02d}.csv".format(i + 1)
        filepath = IO.Path.Combine(SaveFolder, filename)
        writer = IO.StreamWriter(filepath)

        # Transpose: rows = ray directions, columns = points
        transposed = zip(*Isovists)
        for ray_row in transposed:
            line = ",".join([str(round(d, 4)) for d in ray_row])
            writer.WriteLine(line)
        writer.Close()

        ExportedFiles.append(filename)
        print("Saved:", filename, "with", len(Isovists), "samples →", filepath)

    # Outputs
    a = ExportedFiles
    b = RayLines

else:
    print("not started")
    a = []
    b = []
# ---------- end py3 ----------
# Trigger
# Trigger
panel = Panel(py3.a)
