# Grasshopper definition simulate_path_building.gh (Grasshopper 1.0.8)
# plug-ins: PedSimulation

# ----
# generate random start points
panel = Panel("1001")
crv = Curve(<curve referenced from the Rhino model>)
random = Random(Range=Domain(0, 1), Number="100", Seed=panel)
eval = EvaluateCurve(Curve=reparameterize(crv), Parameter=random)  # -> Point, Tangent, Angle

# ----
# generate random interest point
panel_2 = Panel("1001")
crv_2 = Curve(<curve referenced from the Rhino model>)
random_2 = Random(Range=Domain(0, 1), Number="80", Seed=panel_2)
eval_2 = EvaluateCurve(Curve=reparameterize(crv_2), Parameter=random_2)  # -> Point, Tangent, Angle

# ----
# generate random end points
panel_3 = Panel("1001")
crv_3 = Curve(<curve referenced from the Rhino model>)
random_3 = Random(Range=Domain(0, 1), Number="100", Seed=panel_3)
eval_3 = EvaluateCurve(Curve=reparameterize(crv_3), Parameter=random_3)  # -> Point, Tangent, Angle

# ----
# generate random interest point
panel_4 = Panel("1001")
crv_4 = Curve(<curve referenced from the Rhino model>)
random_4 = Random(Range=Domain(0, 1), Number="20", Seed=panel_4)
eval_4 = EvaluateCurve(Curve=reparameterize(crv_4), Parameter=random_4)  # -> Point, Tangent, Angle

pt = Point(<point referenced from the Rhino model>)
pill_tag = BooleanToggle(False)
pill_tag_2 = BooleanToggle(False)
series = Series(Start="0", Step="1", Count="100")
item = ListItem(List=[eval_2.Point, eval_4.Point], Index=series, Wrap=True)
gate = Gate(
    Position=pt,
    GateName="start",
    ExitTime=Slider(0, range=0..1),
    AccessRadius=Slider(0, range=0..1),
    DrawDot=pill_tag,
    Color=ColourSwatch(SwatchColor=RGB(255, 0, 0)))
gate_2 = Gate(
    Position=eval_3.Point,
    GateName="end",
    ExitTime=Slider(0, range=0..1),
    AccessRadius=Slider(0, range=0..1),
    DrawDot=pill_tag_2,
    Color=ColourSwatch(SwatchColor=RGB(38, 117, 252)))
program = ProgramComponent(ProgramName="interest", DisplayColor=ColourSwatch(SwatchColor=RGB(0, 51, 255)))
pt_2 = Point([<point referenced from the Rhino model> x20])
crossref = CrossReference(ListA=gate, ListB=gate_2, CrossMode=1)  # -> ListA, ListB
body_width = Slider(0.3, range=0.3..0.95)
body_width_2 = Slider(0.3, range=0.3..0.95)
pill_tag_3 = BooleanToggle(True)
fanvision = FanShapedVision(Angle=Slider(150, range=0..1000), Distance=Slider(15, range=0..100))
spawn_time = Slider(100, range=1..100, expression="x/4")
target = Target(
    Position=pt_2,
    Program=program,
    VisitingTime=Slider(0, range=0..500),
    AccessRadius=body_width_2,
    DrawDot=pill_tag_3,
    createMultipleTargets=True)
pt_3 = PersonTemplate(
    StartGate=crossref.ListA,
    DestinationGate=crossref.ListB,
    Interests=program,
    NeedValue=Slider(7, range=0..10),
    StartNumber=0,
    Probability=Slider(5.9, range=0..10),
    TimeLimit=-1,
    Vision=fanvision,
    BodyRadius=expr("x/2", body_width),
    TargetForce=20,
    DisplayColor=ColourSwatch(SwatchColor=RGB(5, 235, 89)),
    PersonTemplateDirectionMode=1)
settings = SystemSettings(
    FPS=30,
    ObstacleOffset=1,
    ObstacleRepulsionCoefA=50,
    ObstacleRepulsionCoefB=2,
    ObstacleRepulsionMax=5,
    ObstacleRepulsionThreshold=0.5,
    EnableTrace=Toggle(True))
crv_5 = Curve([<curve referenced from the Rhino model> x37])

# ----
# Trigger
timer = Timer(Interval=10, TimerInterval=10, Target=pedsim)  # disabled

pedsim = PedSimulationSystem(
    Reset=Button(),
    PersonTemplates=pt_3,
    ObstacleCurves=crv_5,
    Population=Slider(10, range=1..10, expression="x*10"),
    Targets=target,
    GenerationTime=spawn_time,
    SystemSettings=settings)  # -> Out, People, GraphEdges, GraphVertices, GoalTagPositions, VisitCounts, PersonRecords
deconspr = DeconstructPersonRecord(PersonRecord=pedsim.PersonRecords)  # -> PersonID, TemplateID, StartTime, EndTime, TimeSequence, TracePositions, TraceSpeeds, StateSequence
pline = PolyLine(Vertices=deconspr.TracePositions, Closed=False)
deconsp = DeconstructPerson(Person=pedsim.People)  # -> ID, TemplateID, Position, BodyRadius, Velocity, Acceleration, CurrentPath, Behaviors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

# ----
# Preview Sightline
drawperson = DrawPerson(People=pedsim.People, drawCurrentTargetFill=True, drawFOV=True, drawNumber=True)

# ----
# Preview Points/Paths
pt_4 = Point(deconsp.Position)
crv_6 = Curve(deconsp.CurrentPath)
