# Grasshopper definition simulate_path_building_soane.gh (Grasshopper 1.0.8)
# plug-ins: PedSimulation

# ----
# generate random start points
panel = Panel("1001")
crv = Curve(<curve referenced from the Rhino model>)
random = Random(Range=Domain(0, 1), Number="10", Seed=panel)
eval = EvaluateCurve(Curve=reparameterize(crv), Parameter=random)  # -> Point, Tangent, Angle

# ----
# generate random end points
panel_2 = Panel("1001")
crv_2 = Curve(<curve referenced from the Rhino model>)
random_2 = Random(Range=Domain(0, 1), Number="10", Seed=panel_2)
eval_2 = EvaluateCurve(Curve=reparameterize(crv_2), Parameter=random_2)  # -> Point, Tangent, Angle

pill_tag = BooleanToggle(False)
pill_tag_2 = BooleanToggle(False)
pt = Point([Point(-3.50216124, -181.9151333, 0), Point(5.004043749, -180.1840416, 0), Point(14.25680216, -181.4522507, 0), Point(23.74912202, -180.4770993, 0), Point(31.69318804, -180.0139839, 0), Point(36.1790325, -180.9650825, 0)])
pt_2 = Point([Point(-358.3517818, 568.5967558, 0), Point(-365.0415996, 577.5166826, 0), Point(-361.3722306, 589.0379626, 0), Point(-348.3197635, 597.0654442, 0), Point(-352.0144361, 617.2836729, 0), Point(-347.9094433, 620.7028199, 0)])
gate = Gate(
    Position=pt,
    GateName="start",
    ExitTime=Slider(0, range=0..1),
    AccessRadius=Slider(0, range=0..1),
    DrawDot=pill_tag,
    Color=ColourSwatch(SwatchColor=RGB(255, 0, 0)))
gate_2 = Gate(
    Position=pt_2,
    GateName="end",
    ExitTime=Slider(0, range=0..1),
    AccessRadius=Slider(0, range=0..1),
    DrawDot=pill_tag_2,
    Color=ColourSwatch(SwatchColor=RGB(38, 117, 252)))
program = ProgramComponent(ProgramName="interest", DisplayColor=ColourSwatch(SwatchColor=RGB(0, 51, 255)))
crossref = CrossReference(ListA=gate, ListB=gate_2, CrossMode=1)  # -> ListA, ListB
body_width = Slider(0.3, range=0.3..0.95)
pt_3 = Point()
body_width_2 = Slider(0.3, range=0.3..0.95)
pt_4 = Point([Point(11.74047212, 4.041541651, 0), Point(20.04682969, 118.2082158, 0), Point(-23.53480198, 244.4085464, 0), Point(-10.10697154, 377.6952914, 0), Point(-24.60197044, 479.3097073, 0), Point(-80.02618971, 494.7268972, 0), Point(-155.8944676, 460.9981361, 0), Point(-169.0213523, 554.0118695, 0), Point(-213.4417114, 598.2703799, 0), Point(-324.8028473, 579.7666695, 0)])
pill_tag_3 = BooleanToggle(True)
fanvision = FanShapedVision(Angle=Slider(150, range=0..1000), Distance=Slider(15, range=0..100))
spawn_time = Slider(52, range=1..100, expression="x/4")
target = Target(
    Position=pt_4,
    Program=program,
    VisitingTime=Slider(0, range=0..500),
    AccessRadius=body_width_2,
    DrawDot=pill_tag_3,
    createMultipleTargets=True)
pt_5 = PersonTemplate(
    StartGate=crossref.ListA,
    DestinationGate=crossref.ListB,
    Interests=program,
    NeedValue=Slider(5, range=0..10),
    StartNumber=0,
    Probability=Slider(3.3, range=0..10),
    TimeLimit=-1,
    Vision=fanvision,
    BodyRadius=expr("x/2", body_width),
    TargetForce=20,
    DisplayColor=ColourSwatch(SwatchColor=RGB(5, 235, 89)),
    PersonTemplateDirectionMode=1)
crv_3 = Curve([<curve referenced from the Rhino model> x55])

# ----
# Trigger
timer = Timer(Interval=10, TimerInterval=10, Target=pedsim)  # disabled

settings = SystemSettings(
    FPS=30,
    ObstacleOffset=1,
    ObstacleRepulsionCoefA=50,
    ObstacleRepulsionCoefB=2,
    ObstacleRepulsionMax=5,
    ObstacleRepulsionThreshold=0.5,
    EnableTrace=Toggle(True))
pedsim = PedSimulationSystem(
    Reset=Button(),
    PersonTemplates=pt_5,
    ObstacleCurves=crv_3,
    Population=Slider(3, range=1..10, expression="x*10"),
    Targets=target,
    GenerationTime=spawn_time,
    SystemSettings=settings)  # -> Out, People, GraphEdges, GraphVertices, GoalTagPositions, VisitCounts, PersonRecords
deconspr = DeconstructPersonRecord(PersonRecord=pedsim.PersonRecords)  # -> PersonID, TemplateID, StartTime, EndTime, TimeSequence, TracePositions, TraceSpeeds, StateSequence
pline = PolyLine(Vertices=deconspr.TracePositions, Closed=False)
deconsp = DeconstructPerson(Person=pedsim.People)  # -> ID, TemplateID, Position, BodyRadius, Velocity, Acceleration, CurrentPath, Behaviors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

# ----
# Preview Sightline
drawperson = DrawPerson(People=pedsim.People, drawCurrentTargetFill=True, drawFOV=True, drawNumber=True)

# ----
# Preview Points/Paths
pt_6 = Point(deconsp.Position)
crv_4 = Curve(deconsp.CurrentPath)
